# Dynamo graph Extract Bearing and Angle.dyn (Dynamo 2.10.1.3976)

# group: Input
file_path = Filename("..\..\Step 2 - Extract Soil Nail Bearing and Angle from Civil 3D\(Output) Bearing and Angle.csv")

# group: Input
file_path_2 = Filename(".\(Input) Coordinate of each layer.csv")

# group: Import points from CSV file
importCSV = Data.ImportCSV(filePath=file_path_2)
number = DoubleInput(0)
getItemAtIndex = List.GetItemAtIndex(list=importCSV, index=number)
number_2 = DoubleInput(1)
getItemAtIndex_2 = List.GetItemAtIndex(list=importCSV, index=number_2)
byCoordinates = Point.ByCoordinates(x=getItemAtIndex, y=getItemAtIndex_2)

# group: Input
string = StringInput("SLP-___-ACM-CutSlope20210413")

# group: Select the surface to be analysis, and covert it from TIN to triangular surfaces
current = Autodesk.AutoCAD.DynamoNodes.Document.Current()
surfaceByName = Autodesk.Civil.DynamoNodes.Selection.SurfaceByName(name=string, document=current)
triangles = Autodesk.Civil.DynamoNodes.TinSurface.Triangles(tinSurface=surfaceByName)
patch = Curve.Patch(curve=triangles)
isNull = Object.IsNull(object=patch)
filterByBoolMask = List.FilterByBoolMask(list=patch, mask=isNull)

# group: Find the projection (z value) of the point
ZAxis = Vector.ZAxis()
project = Point.Project(point=byCoordinates, baseGeometry=filterByBoolMask.out, projectionDirection=ZAxis, lacing=CrossProduct)
isEmpty = List.IsEmpty(list=project@@L2)

# group: To find out the X,Y,Z coordinate, and translate it from meter to millimeter
filterByBoolMask_2 = List.FilterByBoolMask(list=project@L1, mask=isEmpty@@L2)
flatten = List.Flatten(list=filterByBoolMask_2.in)
X = Point.X(point=flatten)
number_3 = DoubleInput(1000)
mul = X * number_3
Y = Point.Y(point=flatten)
mul_2 = Y * number_3
Z = Point.Z(point=flatten)
mul_3 = Z * number_3

# group: To find the normal vector of the surface
boolean = BoolSelector(false)
indexOf = List.IndexOf(list=isEmpty@@L2, element=boolean)
getItemAtIndex_3 = List.GetItemAtIndex(list=filterByBoolMask.out, index=indexOf)
number_4 = DoubleInput(0.5)
normalAtParameter = Surface.NormalAtParameter(surface=getItemAtIndex_3, u=number_4, v=number_4)

# group: To find the bearing angle compare to the North
X_2 = Vector.X(vector=normalAtParameter)
Y_2 = Vector.Y(vector=normalAtParameter)
number_5 = DoubleInput(0)
byCoordinates_2 = Vector.ByCoordinates(x=X_2, y=Y_2, z=number_5)
normalized = Vector.Normalized(vector=byCoordinates_2)
YAxis = Vector.YAxis()
reverse = Vector.Reverse(vector=YAxis)
ZAxis_2 = Vector.ZAxis()
angleAboutAxis = Vector.AngleAboutAxis(vector=normalized, otherVector=reverse, rotationAxis=ZAxis_2)

# group: To find the rotation angle compare to ground surface
normalized_2 = Vector.Normalized(vector=normalAtParameter)
ZAxis_3 = Vector.ZAxis()
angleAboutAxis_2 = Vector.AngleAboutAxis(vector=normalized_2, otherVector=normalized, rotationAxis=ZAxis_3)
number_6 = DoubleInput(180)
gt = angleAboutAxis_2 > number_6
number_7 = DoubleInput(360)
sub = number_7 - angleAboutAxis_2
if_ = If(test=gt, true=sub, false=angleAboutAxis_2)

# group: Gather the information and export as CSV
list_create = List.Create(item0=mul, item1=mul_2, item2=mul_3, item3=angleAboutAxis, item4=if_)
transpose = List.Transpose(lists=list_create)
exportCSV = Data.ExportCSV(filePath=file_path, data=transpose)
