# Dynamo graph Extract Soil Nail Coordinate by St pt and End pt.dyn (Dynamo 2.10.1.3976)

# group: Input (CSV path for output)
file_path = Filename("Sample files\Temp File.csv")

# group: Input (Selete the contour line)
select_object = ObjectSelection()  # 1 picked in the model

geometry = Autodesk.AutoCAD.DynamoNodes.Object.Geometry(object=select_object)

# group: Input (x / y for start piont)
number = DoubleInput(834782.3194)
number_2 = DoubleInput(840539.035)

# group: Input (x / y for end point)
number_3 = DoubleInput(834766.9182)
number_4 = DoubleInput(840493.491)

# group: Find the nearest start point to the curve
startPoint = Curve.StartPoint(curve=geometry)
Z = Point.Z(point=startPoint)
byCoordinates = Point.ByCoordinates(x=number, y=number_2, z=Z)
byCoordinates_2 = Point.ByCoordinates(x=number_3, y=number_4, z=Z)
join = List.Join(list0=byCoordinates, list1=byCoordinates_2)
closestPointTo = Geometry.ClosestPointTo(geometry=geometry, other=join)

# group: Find the parameter of the start point and end point
parameterAtPoint = Curve.ParameterAtPoint(curve=geometry, point=closestPointTo)
number_5 = DoubleInput(0)
getItemAtIndex = List.GetItemAtIndex(list=parameterAtPoint, index=number_5)
number_6 = DoubleInput(1)
getItemAtIndex_2 = List.GetItemAtIndex(list=parameterAtPoint, index=number_6)

# group: Input (Spacing in m)
number_7 = DoubleInput(1.5)

# group: Calculate the parameter of the segment
length = Curve.Length(curve=geometry)
div = number_7 / length

# group: Find the parameter of the points according to the segment
gt = getItemAtIndex > getItemAtIndex_2
code_block = CodeBlock(a=div) { -a; }
if_ = If(test=gt, true=code_block, false=div)
range = Range(start=getItemAtIndex, end=getItemAtIndex_2, step=if_)
pointAtParameter = Curve.PointAtParameter(curve=geometry, param=range)

# group: Export the XYZ coordinates to CSV file
X = Point.X(point=pointAtParameter)
Y = Point.Y(point=pointAtParameter)
Z_2 = Point.Z(point=pointAtParameter)
list_create = List.Create(item0=X, item1=Y, item2=Z_2)
transpose = List.Transpose(lists=list_create)
exportCSV = Data.ExportCSV(filePath=file_path, data=transpose)
