# Dynamo graph Revit Assign Soil Nail (for 20).dyn (Dynamo 2.1.0.7500)

# group: Input
family_types = FamilyTypes("19_SON-TYP-CSH-___-___:Nail Head_400x400")

# group: Input
file_path = Filename(".\Book123.csv")

boolean = BoolSelector(false)
importCSV = Data.ImportCSV(filePath=file_path, transpose=boolean)
number = DoubleInput(0)
getItemAtIndex = List.GetItemAtIndex(list=importCSV, index=number)
number_2 = DoubleInput(1)
getItemAtIndex_2 = List.GetItemAtIndex(list=importCSV, index=number_2)
number_3 = DoubleInput(2)
getItemAtIndex_3 = List.GetItemAtIndex(list=importCSV, index=number_3)
byCoordinates = Point.ByCoordinates(x=getItemAtIndex, y=getItemAtIndex_2, z=getItemAtIndex_3)
byPoint = FamilyInstance.ByPoint(familyType=family_types, point=byCoordinates)
string = StringInput("Soil Nail Inclination")

# group: Input
number_4 = DoubleInput(20)

setParameterByName = Element.SetParameterByName(element=byPoint, parameterName=string, value=number_4)
string_2 = StringInput("Nail Head Angle")
number_5 = DoubleInput(4)
getItemAtIndex_4 = List.GetItemAtIndex(list=importCSV, index=number_5)
setParameterByName_2 = Element.SetParameterByName(element=byPoint, parameterName=string_2, value=getItemAtIndex_4)
number_6 = DoubleInput(3)
getItemAtIndex_5 = List.GetItemAtIndex(list=importCSV, index=number_6)
setRotation = FamilyInstance.SetRotation(familyInstance=byPoint, degree=getItemAtIndex_5)
string_3 = StringInput("Soil Nail Total Length")

# group: Input
number_7 = DoubleInput(4000)

setParameterByName_3 = Element.SetParameterByName(element=byPoint, parameterName=string_3, value=number_7)
string_4 = StringInput("Soil Nail Dia")

# group: Input
number_8 = DoubleInput(50)

setParameterByName_4 = Element.SetParameterByName(element=byPoint, parameterName=string_4, value=number_8)
string_5 = StringInput("Hole Dia")

# group: Input
number_9 = DoubleInput(100)

setParameterByName_5 = Element.SetParameterByName(element=byPoint, parameterName=string_5, value=number_9)
string_6 = StringInput("Nail Head Vertical Cut Angle")

# group: Input
number_10 = DoubleInput(50)

setParameterByName_6 = Element.SetParameterByName(element=byPoint, parameterName=string_6, value=number_10)
